# Dynamo graph Create_Family-CAD.dyn (Dynamo 2.6.1.8786)
# packages: Genius Loci 2021.7.30, bimorphNodes 4.0.9, LinkDWG 0.3.91, spring nodes 204.1.0, Clockwork for Dynamo 2.x 2.3.0, Orchid 206.3.0.7900, archi-lab.net 2022.210.2522

directory_path = Directory("C:\Users\Poste8\Desktop")
directory_from_path = DirectoryObject(path=directory_path)
code_block = CodeBlock { "*.dwg*"; }
getDirectoryContents = FileSystem.GetDirectoryContents(directory=directory_from_path, searchString=code_block)
code_block_2 = CodeBlock(x=getDirectoryContents.files) { x[1]; }
import_dwg = Custom[Import DWG](Filepaths=code_block_2)  # frozen; package Genius Loci; Import DWGs in views with options. Use with the Enumerate DWG import options node. Based on an archilab's script.
code_block_3 = CodeBlock(x=import_dwg.ImportInstance) { x; }
layerNames = Revit.ImportInstance.LayerNames(importInstance=code_block_3)
firstItem = List.FirstItem(list=layerNames@L2)
curvesFromCADLayers = CAD.CurvesFromCADLayers(importInstance=code_block_3, layerNames=firstItem)  # frozen
select_model_element = DSModelElementSelection()  # nothing selected

# group: Processing
boolean = BoolSelector(true)
groupGeometriesByLayer = Custom[GroupGeometriesByLayer](importInstance=select_model_element)  # package LinkDWG; Group geometries in ImportInstance by their layer name and convert the inside meshes into polysurface
code_block_4 = CodeBlock(x=groupGeometriesByLayer.2_Layer_Names) { x; }
importGeometriesByLayer = Custom[ImportGeometriesByLayer](Run=boolean, LayerName=code_block_4)  # package LinkDWG; Import basic geometries (point, line, circle, arc, polyline, spline, 3dface, meshes) from certain layer of active AutoCAD

code_block_5 = CodeBlock { "Visible" + (36..100); }
boolean_2 = BoolSelector(true)

# group: Family
current = Document.Current()
toOrchidType = Orchid.RevitProject.Common.Document.ToOrchidType(document=current)
code_block_6 = CodeBlock { "Plan"; }
create = Orchid.RevitFamily.FamilyType.Create(familyDocument=toOrchidType, name=code_block_6)  # frozen
code_block_7 = CodeBlock(x=importGeometriesByLayer.10_COM_Blocks) { "Visible" + (36..DSCore.List.Count(x)); }
parameter_types = ParameterTypeUi("YesNo")
select_builtin_parameter_group = BuiltInParameterGroup("PG_VISIBILITY")
create_2 = Orchid.RevitFamily.Parameter.Create(familyDocument=toOrchidType, parameterName=code_block_5, type=parameter_types, group=select_builtin_parameter_group, instance=boolean_2)  # frozen

current_2 = Orchid.RevitFamily.FamilyType.Current(familyDocument=toOrchidType)
code_block_8 = CodeBlock { false; }
setValue = Orchid.RevitFamily.Parameter.SetValue(familyDocument=toOrchidType, familyType=current_2, parameterName=code_block_5, value=code_block_8, lacing=Longest)  # frozen
code_block_9 = CodeBlock(x=importGeometriesByLayer.10_COM_Blocks) { x; }
code_block_10 = CodeBlock { 23; }
code_block_11 = CodeBlock(x=code_block_10) { "Visible" + ((27-1)+x+50); }

# group: Create_Curve
code_block_12 = CodeBlock(z=importGeometriesByLayer.12_Dynamo_Geometries) { z; }
code_block_13 = CodeBlock(x=code_block_12, a=code_block_10) { x[a]; }
explode = Geometry.Explode(geometry=code_block_13)
ꟿ_document_activeview = Custom[ꟿ Document.ActiveView]()  # package spring nodes; Selects the current document's active view. Supports more view types than the built-in option. Will be depreciated once the bult in node works with all plan types.
byCurve = Custom[DetailCurve.ByCurve+](curve=explode, view=ꟿ_document_activeview)  # package Clockwork for Dynamo 2.x; Creates a detail line based on a given curve. Unlike the OOTB node it can also draw circles.

flatten = List.Flatten(list=byCurve)
code_block_14 = CodeBlock { "Visible"; }
associate = Orchid.RevitFamily.Parameter.Associate(familyDocument=toOrchidType, parameterName=code_block_11, element=flatten, elementParameter=code_block_14)
