# Dynamo graph Floor by Room v2.dyn (Dynamo 2.6.1.8786)
# packages: Ampersand 2019.12.31, Clockwork for Dynamo 1.x 1.33.1, spring nodes 204.1.0

categories = Categories("OST_Rooms")  # graph input
all_elements_of_category = ElementsOfCategory(Category=categories)
code_block = CodeBlock { "Level"; }
getParameterValueByName = Element.GetParameterValueByName(element=all_elements_of_category, parameterName=code_block)
code_block_2 = CodeBlock { "B2F"; }
contains = String.Contains(str=getParameterValueByName, searchFor=code_block_2, lacing=CrossProduct)
watch = Watch()  # unwired: arg0
levels = Levels("+102.75 B2F PLATFORM (FFL)")  # graph input
name = Level.Name(level=levels)
eq = name == getParameterValueByName
filterByBoolMask = List.FilterByBoolMask(list=all_elements_of_category, mask=eq)
watch_2 = Watch(filterByBoolMask.in)
boundaries = Custom[Room.Boundaries](room=watch_2)  # package Clockwork for Dynamo 1.x; Gets a list of all boundaries of a given room or area and a corresponding list of the elements that are generating those boundaries.
watch_3 = Watch(boundaries.curves)
polycurve_bycurves = Custom[[&] PolyCurve.ByCurves](curves=boundaries.curves)  # package Ampersand; Create polycurves from an unordered list of curves.
byPatch = Surface.ByPatch(closedCurve=polycurve_bycurves)
area = Surface.Area(surface=byPatch)
maximumItem = List.MaximumItem(list=area)
eq_2 = maximumItem == area
filterByBoolMask_2 = List.FilterByBoolMask(list=polycurve_bycurves, mask=eq_2)
watch_4 = Watch(filterByBoolMask_2.in)
floor_types = FloorTypes("C1060.10_Resilient Vinyl Tile_600x600x3mm")
byOutlineTypeAndLevel = Floor.ByOutlineTypeAndLevel(outlineCurves=watch_4, floorType=floor_types, level=levels)
watch_5 = Watch(filterByBoolMask_2.out)
explode = Geometry.Explode(geometry=watch_5)
ꟿ_opening_infloorbycurves = Custom[ꟿ Opening.InFloorByCurves](host=byOutlineTypeAndLevel, curves=explode)  # package spring nodes; Create hosted floor opeinngs through the input floors. The second input is a list of sub-lists of the boundary curves.
