# Dynamo graph Fromwork_Stairs.dyn "kalıpalan" (Dynamo 2.6.1.8786)
# packages: Clockwork for Dynamo 2.x 2.3.0, spring nodes 204.1.0

# group: KalıpAlan İşlemleri
code_block = CodeBlock()
# ---------- code_block.designscript (21 lines) ----------
def KalıpAlan (s:var[]..[])
{
	a=	DSCore.List.Chop(DSCore.List.FirstItem(s@L2<1>),1);
	b=	PolySurface.BySolid(a).Surfaces();
	b0=	Surface.TangentAtUParameter(b,1,1);

	//Kalıp
	k0=	Vector.IsParallel(b0,Vector.ZAxis());
	k1= DSCore.List.FilterByBoolMask(b,k0)["out"];
	k2=	DSCore.List.FilterByBoolMask(b,k0)["in"];
	k3=	Surface.TangentAtUParameter(k1,1,1).X==1 ? true:false;
	k4=	DSCore.List.FilterByBoolMask(k1,k3)["out"];

	//Toplam alan
	sp=	DSCore.List.Transpose(Surface.ByUnion([k2,k4])).ByUnion();
	sp1=sp.ByUnion();
	sp2=sp1.Surfaces();
	//ta=	Math.Sum(Surface.Area(sp));
	return [sp1,sp2];

};
# ----------------------------------------

# group: Merdivenin Konumuna Göre Kalıp Hesabı
code_block_2 = CodeBlock()
# ---------- code_block_2.designscript (32 lines) ----------
def gen (s:var[]..[])
{
	gmty= KalıpAlan(s);

	//Surface Coordinate System
	sc=	Surface.CoordinateSystemAtParameter(gmty[0],1,1);
	//Cuboid-Center
	cs1 = CoordinateSystem.Identity().Transform(sc);
	gb1 = Geometry.BoundingBox.ByGeometry(gmty[0].Transform(cs1,CoordinateSystem.Identity())<1>);
	gb2 = DSCore.Math.Round(gb1.MinPoint.DistanceTo(gb1.MaxPoint),3);
	gb3 = DSCore.List.SortByKey(gb1,gb2)["sorted list"].ToCuboid();
	kbg	= Cuboid.Width(gb3);
	cs2 = DSCore.List.SortByKey(cs1,gb2)["sorted list"];
	cub	= DSCore.List.Sort(gb3.Transform(CoordinateSystem.Identity(),cs2).Centroid());
	//Walls
	a=	Revit.ElementQueries.OfCategory(Category.ByName("Walls"));
	b=	Wall.GetLocation(a);

	//Filter-Distance
	dc=		Autodesk.Geometry.DistanceTo(b@L2<1L>,cub@L1<1L>)>kbg+25? false:true;
	dc1=	DSCore.List.FilterByBoolMask(b@L2<1L>,dc@L2<1L>)["in"];
	dc2=	DesignScript.Curve.Extrude(dc1,Vector.ZAxis(),300);
	//Filter-Surface
	sp1=	DSCore.List.IsEmpty(dc1@L2<1>);
	sp2=	DSCore.List.FilterByBoolMask(gmty[0],sp1)["in"];
	sp3=	DSCore.List.FilterByBoolMask(gmty[1],sp1)["out"];
	sp0=	sp3.PointAtParameter(0.5,0.5);
	sp_=	Surface.Area(sp2);
	return [sp2,sp3,dc2,sp0,sp_];


};
# ----------------------------------------

code_block_3 = CodeBlock { "Stairs"; }
code_block_4 = CodeBlock(x=code_block_3) { a=	Revit.ElementQueries.OfCategory(Category.ByName(x)); b=	Elements.Element.Geometry(a); }
# note: ClockWork İndir
byUnion = Custom[Solid.ByUnion+](solids=code_block_4.b)  # package Clockwork for Dynamo 2.x; The OOTB node Solid.ByUnion occasionally fails when trying to merge solids with almost adjacent faces. This node will return the minimum amount of joined solids possible in such cases instead of returning null.
code_block_5 = CodeBlock(s=byUnion) { gen(s); }
code_block_6 = CodeBlock(Yanındaduvarolmayanmerdiven=code_block_5, Alan=code_block_5) { Yanındaduvarolmayanmerdiven[0]; Alan[4]; }

# group: Filtreli Kalıp Alan
code_block_7 = CodeBlock()
# ---------- code_block_7.designscript (9 lines) ----------
def top (s:var[]..[],v:var[]..[])
{
	a=	v>13? true:false;
	b=	DSCore.List.FilterByBoolMask(gen(s)[1],a)["in"];
	c=	b.ByUnion();
	d=	Surface.Area(c);

	return [c,d];
};
# ----------------------------------------

code_block_8 = CodeBlock(pon=code_block_5) { pon[3]; }
code_block_9 = CodeBlock(duv=code_block_5) { duv[2]; }
# note: Springs İndir
ꟿ_geometry_indexbydistance = Custom[ꟿ Geometry.IndexByDistance](geometry=code_block_8@L2, other=code_block_9@L2)  # package spring nodes; Provides the index of the closest or farthest geometry. Should prove faster than getting the geometry and finding its index in two separate operations.
code_block_10 = CodeBlock(s=byUnion, v=ꟿ_geometry_indexbydistance.distance) { top(s,v); }
code_block_11 = CodeBlock(Yanındaduvarolanmerdiven=code_block_10, Alan=code_block_10) { Yanındaduvarolanmerdiven[0]; Alan[1]; }
