# Dynamo graph GoogleTranslateDS.dyn (Dynamo 2.11.1.4675)

# group: Full ISO Language paring codes
code_block = CodeBlock()
# ---------- code_block.designscript (35 lines) ----------
// Language Codes: I-Z
Icelandic = "is";
Indonesian = "id";
Irish = "ga";
Italian = "it";
Japanese = "ja";
Kannada = "kn";
Korean = "ko";
Latin = "la";
Latvian = "lv";
Lithuanian = "lt";
Macedonian = "mk";
Malay = "ms";
Maltese	= "mt";
Norwegian = "no";
Persian = "fa";
Polish = "pl";
Portuguese = "pt";
Romanian = "ro";
Russian = "ru";
Serbian = "sr";
Slovak = "sk";
Slovenian = "sl";
Spanish = "es";
Swahili = "sw";
Swedish = "sv";
Tamil = "ta";
Telugu = "te";
Thai = "th";
Turkish = "tr";
Ukrainian = "uk";
Urdu = "ur";
Vietnamese = "vi";
Welsh = "cy";
Yiddish	= "yi";
# ----------------------------------------
code_block_2 = CodeBlock()
# ---------- code_block_2.designscript (33 lines) ----------
// Language Codes: Auto
auto = "auto";
// Language Codes: A-H
Afrikaans = "af";
Albanian = "sq";
Arabic = "ar";
Azerbaijani	= "az";
Basque = "eu";
Bengali	= "bn";
Belarusian = "be";
Bulgarian = "bg";
Catalan = "ca";
ChineseSimplified = "zh-CN";
ChineseTraditional = "zh-TW";
Croatian = "hr";
Czech = "cs";
Danish = "da";
Dutch = "nl";
English = "en";
Esperanto = "eo";
Estonian = "et";
Filipino = "tl";
Finnish = "fi";
French = "fr";
Galician = "gl";
Georgian = "ka";
German = "de";
Greek = "el";
Gujarati = "gu";
HaitianCreole = "ht";
Hebrew = "iw";
Hindi = "hi";
Hungarian = "hu";
# ----------------------------------------

code_block_3 = CodeBlock { text = " "; }
code_block_4 = CodeBlock(sourceLang=code_block.Turkish, targetLang=code_block_2.English, sourceText=code_block_3) { "https://translate.googleapis.com/translate_a/single?client=gtx&sl=" + sourceLang + "&tl=" + targetLang + "&dt=t&q=" + sourceText; }
code_block_5 = CodeBlock(r=code_block_4)
# ---------- code_block_5.designscript (17 lines) ----------
//Prends Reponse Google.Translate
a=	WebRequest.ByUrl(r);
a1=	WebRequest.Execute(a);
a2=	WebResponse.Content(a1);
//Filter String
s=	DSCore.String.Split(a2,["[","]"]);
s1=	DSCore.String.Split(DSCore.List.FirstItem(DSCore.List.FilterByBoolMask(s,DSCore.String.Length(s)>2)["in"]@L2<1>),"\"");

//Origin Text
ot=	DSCore.List.GetItemAtIndex(s1@L2<1>,2);
//Target Text
tt=	DSCore.List.GetItemAtIndex(s1@L2<1>,0);

//Cree Dictionnaire
d=	DesignScript.Dictionary.ByKeysValues(ot,tt);
d1=	DesignScript.Dictionary.Values(d);
d2=	DesignScript.Dictionary.Keys(d);
# ----------------------------------------
