# Dynamo graph Link_Dimension-Grids.dyn "LinkElemGrid" (Dynamo 2.6.1.8786)
# packages: Genius Loci 2021.3.23, archi-lab.net 2021.25.2621, Rhythm 2021.4.1

select_model_element = DSModelElementSelection()  # 1 picked in the model
element_locationcurve = Custom[Element LocationCurve](element=select_model_element)  # package Genius Loci; Gets the curve geometry from the element.
getDocuments = archilab.Revit.Selection.Select.GetDocuments()
categories = Categories("OST_Grids")
ʳʰʸᵗʰᵐ_collector = Rhythm.Revit.Selection.Collector.ElementsOfCategoryInDocument(document=getDocuments.Link_Doc, category=categories)
element_locationcurve_2 = Custom[Element LocationCurve](element=ʳʰʸᵗʰᵐ_collector@L1)
element_reference = Custom[Element Reference](element=ʳʰʸᵗʰᵐ_collector@L1)  # package Genius Loci; Gets the reference of a geometric object or a dimension or a reference plane.
code_block = CodeBlock(x=element_locationcurve_2, e=element_reference) { a=	x==null? true:false; b=	DSCore.List.FilterByBoolMask(e,a)["out"]; }
code_block_2 = CodeBlock(x=element_locationcurve_2, e=element_locationcurve_2) { a=	x==null? true:false; b=	DSCore.List.FilterByBoolMask(e,a)["out"]; }
group_parallel_lines = Custom[Group Parallel Lines](lines=code_block_2.b)  # package Genius Loci; Groups parallel lines or linear elements together.
allIndicesOf = List.AllIndicesOf(list=code_block_2.b, item=group_parallel_lines)
flatten = List.Flatten()  # unwired: list
map = List.Map(list=allIndicesOf, f_x=flatten)
getItemAtIndex = List.GetItemAtIndex(list=code_block.b, index=map)
code_block_3 = CodeBlock(a=getItemAtIndex) { x=	a[1]; y=	a[0]; }
dimension_byreferences = Custom[Dimension ByReferences](line=element_locationcurve, references=code_block_3.y)  # package Genius Loci; Creates a new linear dimension from at least two geometric references of an object.
