# Dynamo custom node TransferProjectStandards.dyf (Dynamo 2.6.1.8786)
# category: DC_.Document.Standards

Run = Input(_Run: bool = false)
docOrRevitLinkInstance = Input(_docOrRevitLinkInstance: var = null)  # Use only if you want to query a linked model
python_script = Python(IN[0]=Run, IN[1]=docOrRevitLinkInstance)
# ---------- python_script.python (36 lines) ----------
import clr
clr.AddReference("RevitAPI")
from Autodesk.Revit.DB import *
clr.AddReference("RevitAPIUI")
import Autodesk
from Autodesk.Revit.UI import RevitCommandId
from Autodesk.Revit.UI import UIApplication
from Autodesk.Revit.UI import ExternalCommandData
clr.AddReference("RevitServices")
import RevitServices
from RevitServices.Persistence import DocumentManager
from RevitServices.Transactions import TransactionManager

inputdoc = UnwrapElement(IN[1])
if inputdoc == None:
	doc = DocumentManager.Instance.CurrentDBDocument
elif isinstance (inputdoc, RevitLinkInstance) :
	doc = inputdoc.GetLinkDocument()
elif isinstance (inputdoc, Document) :
	doc = inputdoc
else: doc = None

uiapp = DocumentManager.Instance.CurrentUIApplication

Run = IN[0]

if Run == True:
	CmndID = RevitCommandId.LookupCommandId("ID_TRANSFER_PROJECT_STANDARDS")
	CmId = CmndID.Id
	uiapp.PostCommand(CmndID)
	sonuc = "Başarılı"
else:
	sonuc = "Tekrar Dene"

#Assign your output to the OUT variable
OUT = sonuc
# ----------------------------------------
OUT = Output(python_script)
