# Dynamo graph Transfer_Document_Standart-Project.dyn (Dynamo 2.6.1.8786)
# packages: Rhythm 2021.4.1

# group: Input
directory_path = Directory("C:\Users\durmu\Desktop")
code_block = CodeBlock { "*.rvt*"; }
boolean = BoolSelector(true)

# group: Processing
directory_from_path = DirectoryObject(path=directory_path)
getDirectoryContents = FileSystem.GetDirectoryContents(directory=directory_from_path, searchString=code_block)
ʳʰʸᵗʰᵐ_applications = Rhythm.Revit.Application.Applications.OpenDocumentFile(filePath=getDirectoryContents.files)
transferProjectStandards = Custom[TransferProjectStandards](Run=boolean, docOrRevitLinkInstance=ʳʰʸᵗʰᵐ_applications)
code_block_2 = CodeBlock(a=ʳʰʸᵗʰᵐ_applications, b=transferProjectStandards) { [a,b][0]; }

# group: Save_Document
ʳʰʸᵗʰᵐ_documents_saveas = Rhythm.Revit.Application.Documents.SaveAs(document=code_block_2, filePath=getDirectoryContents.files)
